# Grasshopper definition curve-repel.gh (Grasshopper 1.0.4)

crv = Curve([<curve referenced from the Rhino model> x4])
divide = DivideCurve(Curve=crv, Count=30, Kinks=False)  # -> Points, Tangents, Parameters
pline = PolyLine(Vertices=divide.Points, Closed=False)
col = Colour(RGB(52, 237, 89))
python = GhPythonScript(polys=flatten(pline))  # -> out, a; inputs polys: list of Polyline
# ---------- python: Python ----------
__author__ = "seah"

import rhinoscriptsyntax as rs
from Rhino.Geometry import Polyline, Point3d, Vector3d

cols=[]
print(len(polys))
for i in range(len(polys)):
    pl=polys[i]
    #print(pl[0])
    pts=[]
    for p in pl:
        pts.append(Point3d(p[0],p[1],p[2]))
    #pts=rs.CurveEditPoints(pl)
    cols.append(pts)


solver_max=100
force_factor=0.1
min_dist=0.1
gap=6
def push_pt_from_crv(pt,crv,r,factor=0.1):
    t=rs.CurveClosestPoint(crv,pt)
    cp=rs.EvaluateCurve(crv,t)
    dist=rs.Distance(pt,cp)
    #print(dist)
    vect=Vector3d(0,0,0)
    if dist<r:
        if dist<min_dist:
            vect=rs.VectorUnitize(pt-cp)
            vect*=min_dist
        else:
            vect=(pt-cp)
            force=1-(dist/r)
            if force<0:
                print(force)
            vect*=force*factor
        pt+=vect
        #print('{}|{}').format(vect,force)
    return pt,vect
    
#print(len(cols))
for step in range(solver_max):
    for i in range(len(cols)):
        for j in range(len(cols[i])):
            pt=cols[i][j]
            #print(step,i)
            mvect=Vector3d(0,0,0)
            if i>0:
                left=rs.AddPolyline(cols[i-1])
                temp,vect=push_pt_from_crv(pt,left,r=gap,factor=force_factor)
                mvect+=vect
            if i<len(cols)-1:
                right=rs.AddPolyline(cols[i+1])
                temp,vect=push_pt_from_crv(pt,right,r=gap,factor=force_factor)
                mvect+=vect
            cols[i][j]=pt+mvect
            
opoly=[]
for pts in cols:
    opoly.append(rs.AddPolyline(pts))
a=opoly
# ---------- end python ----------
preview = CustomPreview(Geometry=pline, Shader=col)
crv_2 = Curve(python.a)
