# Grasshopper definition film.gh (Grasshopper 1.0.4)
# plug-ins: setFlounderCamera

timer = Timer(TimerInterval=200, Target=ghpython_script)  # disabled
ghpython_script = GhPythonScript(viewport="Perspective")  # -> out, O_DISPLAY, O_CAM_LOC, O_CAM_TRG, O_CAM_LENS, O_CAM_UP
# ---------- ghpython_script: Python ----------
__author__ = "lisi"

import rhinoscriptsyntax as rs
import Rhino.RhinoDoc as rd

if viewport is None:
    viewport='Perspective'
    
def format_point(p):
    txt='{},{},{}'.format(p[0],p[1],p[2])
    #txt="%f,%f,%f"%(p[0],p[1],p[2])
    return txt
    
def get_text():

    txt=''
    txt+=format_point(O_CAM_LOC)+';'
    txt+=format_point(O_CAM_TRG)+';'
    txt+='{}'.format(O_CAM_LENS)+';'
    txt+=format_point(O_CAM_UP)+'\n'
    return txt


O_CAM_LOC,O_CAM_TRG=rs.ViewCameraTarget(viewport)
O_CAM_LENS=rs.ViewCameraLens(viewport)
O_CAM_UP=rs.ViewCameraUp(viewport)

O_DISPLAY=get_text()
# ---------- end ghpython_script ----------
update = Button()
reset = Button()
load = Button()
save = Button()
add = Button()
file_path = FilePath("C:\Users\lisi\Documents\deisgn\M2914_HNZZ_finite_element_analysis\rhino_models\camera_position.txt")
line = Line(StartPoint=ghpython_script.O_CAM_LOC, EndPoint=ghpython_script.O_CAM_TRG)
python = GhPythonScript(
    camera_loc=ghpython_script.O_CAM_LOC,
    camera_trg=ghpython_script.O_CAM_TRG,
    lens=ghpython_script.O_CAM_LENS,
    up=ghpython_script.O_CAM_UP,
    reset=reset,
    add=add,
    update=update,
    index="2",
    trg_file=file_path,
    save_button=save,
    load_button=load)  # -> out, O_DISPLAY, O_CAMLOC, O_CAMTRG, O_LENSES, O_UPS; inputs camera_loc: Point3d, camera_trg: Point3d, up: Vector3d, reset: Boolean, add: Boolean, update: Boolean, index: Int32, save_button: Boolean, load_button: Boolean
# ---------- python: Python ----------
__author__ = "seah"

import rhinoscriptsyntax as rs
from Rhino.Geometry import Point3d, Vector3d

def format_point(p):
    txt='{},{},{}'.format(p[0],p[1],p[2])
    #txt="%f,%f,%f"%(p[0],p[1],p[2])
    return txt

def get_text():
    def get_entry(i):
        txt=''
        txt+=format_point(camloc[i])+';'
        txt+=format_point(camtrg[i])+';'
        txt+='{}'.format(lens)+';'
        txt+=format_point(ups[i])+'\n'
        return txt
        
    txt=''
    for i in range(len(camloc)):
        txt+=get_entry(i)
    display=txt
    return txt
    
def interpret_line(txt):
    def get_point(txt):
        p=txt.split(',')
        return Point3d(float(p[0]),float(p[1]),float(p[2]))
    def get_vector(txt):
        p=txt.split(',')
        return Vector3d(float(p[0]),float(p[1]),float(p[2]))
    phrases=txt.split(';')
    tloc=get_point(phrases[0])
    ttrg=get_point(phrases[1])
    tlens=float(phrases[2])
    tup=get_point(phrases[3])
    return tloc,ttrg,tlens,tup


if add:
    camloc.append(camera_loc)
    camtrg.append(camera_trg)
    lenses.append(lens)
    ups.append(up)


if update:
    camloc[index]=camera_loc
    camtrg[index]=camera_trg
    lenses[index]=lens
    ups[index]=up
    

if reset:
    camloc=[]
    camtrg=[]
    lenses=[]
    ups=[]
    display=''

if save_button:
    with open(trg_file,'w') as f:
        f.write(get_text())
    print('cam pos saved to '+trg_file)

if load_button:
    camloc=[]
    camtrg=[]
    lenses=[]
    ups=[]
    display=''
    
    f= open(trg_file,'r')
    lines=f.readlines()
    for line in lines:
        tloc,ttrg,tlens,tup=interpret_line(line)
        camloc.append(tloc)
        camtrg.append(ttrg)
        lenses.append(tlens)
        ups.append(tup)
        


O_CAMLOC=camloc
O_CAMTRG=camtrg
O_LENSES=lenses
O_UPS=ups
O_DISPLAY=get_text().split('\n')
# ---------- end python ----------
panel = Panel(ghpython_script.O_DISPLAY)
panel_2 = Panel(python.O_DISPLAY)

button = Button()
timer_2 = Timer(TimerInterval=100)
ghpython_script_2 = GhPythonScript(
    viewport="Perspective",
    camlocs=python.O_CAMLOC,
    camtrgs=python.O_CAMTRG,
    lenses=python.O_LENSES,
    ups=python.O_UPS,
    index="7")  # -> out, O_VIEWPORT, O_CAMLOC, O_CAMTRG, O_CAMLENS, O_CAMUP; inputs camlocs: list of Point3d, camtrgs: list of Point3d, lenses: list, ups: list of Vector3d, index: Int32
# ---------- ghpython_script_2: Python ----------
__author__ = "lisi"

import rhinoscriptsyntax as rs


O_CAMLOC=camlocs[index]
O_CAMTRG=camtrgs[index]
O_CAMLENS=lenses[index]
O_CAMUP=ups[index]
O_VIEWPORT=viewport
# ---------- end ghpython_script_2 ----------
syncfloundercamera = SyncFlounderCamera(
    Activate=Toggle(False),
    ViewportName=ghpython_script_2.O_VIEWPORT,
    Location=ghpython_script_2.O_CAMLOC,
    Target=ghpython_script_2.O_CAMTRG,
    Lens=ghpython_script_2.O_CAMLENS,
    Up=ghpython_script_2.O_CAMUP)

cluster = Cluster(vertices=python.O_CAMLOC, vertices_2=python.O_CAMTRG)  # -> curve_2, curve
curve = Curve(cluster.curve)
curve_2 = Curve(cluster.curve_2)

timer_3 = Timer(TimerInterval=20, Target=frame_generator)
number_slider = Slider(80, range=0..80)

panel_3 = Panel("""30
30
30
30
30
30
20""")
pt = Point(python.O_CAMLOC)
pt_2 = Point(python.O_CAMTRG)
mass_addition = MassAddition(Input=panel_3)  # -> Result, PartialResults
num = Number(python.O_LENSES)
vec = Vector(python.O_UPS)
panel_4 = Panel(mass_addition.Result)

frame_generator = GhPythonScript(frame_count=mass_addition.Result, run=Toggle(True), loop=Toggle(True))  # -> out, a; inputs run: Boolean, loop: Boolean
# ---------- frame_generator: Python ----------
__author__ = "lisi"

import rhinoscriptsyntax as rs


if run:
    frame+=1
    if frame>=frame_count-1:
        if loop:
            frame=0
        else:
            frame=frame_count-1
    a=frame
else:
    frame=0
# ---------- end frame_generator ----------
panel_5 = Panel(frame_generator.a)

ghpython_script_3 = GhPythonScript(camloc=pt, camtrg=pt_2, lenses=num, ups=vec, intervals=panel_3, init_t=frame_generator.a)  # -> out, O_CAMLOC, O_CAMTRG, O_LENSES, O_UPS, a; inputs camloc: list of Point3d, camtrg: list of Point3d, lenses: list, ups: list of Vector3d, intervals: list of Int32, init_t: Int32
# ---------- ghpython_script_3: Python ----------
__author__ = "lisi"

import rhinoscriptsyntax as rs
from Rhino.Geometry import Vector3d

max_frame=sum(intervals)

def get_segment(t):
    level=0
    last_level=0
    for i in range(len(intervals)):
        level+=intervals[i]
        if t<level:
            return i,t-last_level
        last_level=level

def get_crv_param(t,seg,pts,crv):
    t1=rs.CurveClosestPoint(crv,pts[seg])
    t2=rs.CurveClosestPoint(crv,pts[seg+1])
    td=t2-t1
    step=td/intervals[seg]
    param=(t*step)+t1
    return rs.EvaluateCurve(crv,param)



frame_num=init_t
if frame_num >= max_frame-1:
    frame_num=max_frame-1

camloc_crv=rs.AddInterpCurve(camloc,degree=3,knotstyle=1)
camtrg_crv=rs.AddPolyline(camtrg)

seg,fn=get_segment(frame_num)
O_CAMLOC=get_crv_param(fn,seg,camloc,camloc_crv)
O_CAMTRG=get_crv_param(fn,seg,camtrg,camtrg_crv)
O_LENSES=lenses[seg]
#O_UPS=ups[seg]
O_UPS=Vector3d(0,0,1)
# ---------- end ghpython_script_3 ----------
point = Point(ghpython_script_3.O_CAMLOC)
syncfloundercamera_2 = SyncFlounderCamera(
    Activate=Toggle(True),
    ViewportName="APerspectiveSync",
    Location=ghpython_script_3.O_CAMLOC,
    Target=ghpython_script_3.O_CAMTRG,
    Lens=ghpython_script_3.O_LENSES,
    Up=ghpython_script_3.O_UPS)
panel_6 = Panel(ghpython_script_3.O_CAMLOC)

# ==== cluster Cluster
vertices = ClusterInput()
vertices_2 = ClusterInput()
interpolate = Interpolate(Vertices=vertices_2, Degree=1, Periodic=False, KnotStyle=1)  # -> Curve, Length, Domain
curve = ClusterOutput(interpolate.Curve)
interpolate_2 = Interpolate(Vertices=vertices, Degree=3, Periodic=False, KnotStyle=1)  # -> Curve, Length, Domain
curve_2 = ClusterOutput(interpolate_2.Curve)
