# Grasshopper definition matrix.gh (Grasshopper 0.9.76)
# plug-ins: Python Interpreter

python = PythonScript()  # -> out, a
# ---------- python: Python ----------
import rhinoscriptsyntax as rs

def format(data,u,v,w):
    txt=''
    for i in range(u):
        for j in range(v):
            for k in range(w):
                index=getIndex(i,j,k,u,v,w)
                txt+=str(data[index])+','
            txt+='\n'
        txt+='------------------\n'
    return txt
def getIndex(u,v,w,sU,sV,sW):
    return w+v*sW+(sV*sW)*u
    
u=v=w=3
data=[0]*(u*v*w)
data[getIndex(1,1,2,3,3,3)]=5
t=format(data,u,v,w)
print(t)
# ---------- end python ----------
python_2 = PythonScript()  # -> out, a
# ---------- python_2: Python ----------
from runner import run

a=run()
# ---------- end python_2 ----------
panel = Panel(python.out)
