# Grasshopper definition morph.gh (Grasshopper 1.0.4)
# plug-ins: setFlounderCamera, Kangaroo2 Components, getFlounderCamera

number_slider = Slider(3, range=0..6)
list = ValueList({"One": 0, "Two": 1, "Three": 2, "Four": 3, "Five": 4, "Six": 5}, selected="One")
surface = Surface(<surface referenced from the Rhino model>)
surface_2 = Surface(<surface referenced from the Rhino model>)
surface_3 = Surface(<surface referenced from the Rhino model>)
brep = Brep(<brep referenced from the Rhino model>)
brep_2 = Brep(<brep referenced from the Rhino model>)
brep_3 = Brep(<brep referenced from the Rhino model>)
surface_4 = Surface(surface)
surface_5 = Surface([<surface referenced from the Rhino model> x6])
merge = Merge(Data1=surface, Data2=surface_2, Data3=surface_3, Data4=brep, Data5=brep_3, Data6=brep_2)
list_item = ListItem(List=merge, Index=list, Wrap=True)
mesh_plane = MeshPlane(Boundary=surface_4, WidthCount=20, HeightCount=11)  # -> Mesh, Area
brep_4 = Brep(list_item)
Y = UnitY(Factor=1000)
demesh = DeconstructMesh(Mesh=mesh_plane.Mesh)  # -> Vertices, Faces, Colours, Normals
Y_2 = UnitY(Factor=-1)
mesh = MeshBrep(
    Brep=brep_4,
    Settings={GridMaxCount=0, GridMinCount=16, JaggedSeams=False, MaxEdgeLength=0, MinEdgeLength=0.0001, MinTolerance=0, Refine=True, RefineAngle=0, RelativeTolerance=0.65, SimplePlanes=True, Tolerance=0})
move = Move(Geometry=demesh.Vertices, Motion=Y)  # -> Geometry, Transform
wind = Wind(WindVector=Vector(1, 0, 0))
meshray = MeshRay(Mesh=mesh, Point=move.Geometry, Direction=Y_2)  # -> Point, Hit
pt = Point(meshray.Point)
pt_2 = Point(demesh.Vertices)
python = GhPythonScript(src_pts=flatten(pt_2), trg_pts=flatten(pt), run=Toggle(True))  # -> out, a; inputs src_pts: list of Point3d, trg_pts: list of Point3d, run: Boolean
# ---------- python: Python ----------
__author__ = "seah"

import rhinoscriptsyntax as rs
from random import Random
rand=Random()

if run:
    for i in range(len(ops)):
        if restarts[i]:
            if step%delays[i]!= 0:
                continue
            else:
                restarts[i]=False
            
        p1=ops[i]
        p2=trg_pts[i]
        if p2 is None: 
            continue
        
        dist=p1.DistanceTo(p2)
        if dist<0.001:
            restarts[i]=True
            continue
        vect=rs.VectorUnitize(p2-p1)
        print(dist)
        vect*=dist*0.2
        p1+=vect
        ops[i]=p1
    a=ops
    step+=1
else:
    ops=[]
    delays=[]
    restarts=[True]*len(src_pts)
    step=1
    
    for p in src_pts:
        ops.append(p)
        delays.append(rand.randrange(1,12))
# ---------- end python ----------
timer = Timer(TimerInterval=20, Target=python)
pt_3 = Point(python.a)
toggle = BooleanToggle(True)
getfloundercamera = GetFlounderCamera(Activate=toggle, ViewportName="cam_pos_8")  # -> Location, Target, Lens, Up
update = Button()
load = Button()
reset = Button()
save = Button()
add = Button()
file_path = FilePath("C:\Users\lisi\Documents\deisgn\M2914_HNZZ_finite_element_analysis\rhino_models\camera_position.txt")
python_2 = GhPythonScript(
    camera_loc=getfloundercamera.Location,
    camera_trg=getfloundercamera.Target,
    lens=getfloundercamera.Lens,
    up=getfloundercamera.Up,
    reset=reset,
    add=add,
    update=update,
    index="2",
    trg_file=file_path,
    save_button=save,
    load_button=load)  # -> out, O_DISPLAY, O_CAMLOC, O_CAMTRG, O_LENSES, O_UPS; inputs camera_loc: Point3d, camera_trg: Point3d, up: Vector3d, reset: Boolean, add: Boolean, update: Boolean, index: Int32, save_button: Boolean, load_button: Boolean
# ---------- python_2: Python ----------
__author__ = "seah"

import rhinoscriptsyntax as rs
from Rhino.Geometry import Point3d, Vector3d

def format_point(p):
    txt='{},{},{}'.format(p[0],p[1],p[2])
    #txt="%f,%f,%f"%(p[0],p[1],p[2])
    return txt

def get_text():
    def get_entry(i):
        txt=''
        txt+=format_point(camloc[i])+';'
        txt+=format_point(camtrg[i])+';'
        txt+='{}'.format(lens)+';'
        txt+=format_point(ups[i])+'\n'
        return txt
        
    txt=''
    for i in range(len(camloc)):
        txt+=get_entry(i)
    display=txt
    return txt
    
def interpret_line(txt):
    def get_point(txt):
        p=txt.split(',')
        return Point3d(float(p[0]),float(p[1]),float(p[2]))
    def get_vector(txt):
        p=txt.split(',')
        return Vector3d(float(p[0]),float(p[1]),float(p[2]))
    phrases=txt.split(';')
    tloc=get_point(phrases[0])
    ttrg=get_point(phrases[1])
    tlens=float(phrases[2])
    tup=get_point(phrases[3])
    return tloc,ttrg,tlens,tup


if add:
    camloc.append(camera_loc)
    camtrg.append(camera_trg)
    lenses.append(lens)
    ups.append(up)


if update:
    camloc[index]=camera_loc
    camtrg[index]=camera_trg
    lenses[index]=lens
    ups[index]=up
    

if reset:
    camloc=[]
    camtrg=[]
    lenses=[]
    ups=[]
    display=''

if save_button:
    with open(trg_file,'w') as f:
        f.write(get_text())
    print('cam pos saved to '+trg_file)

if load_button:
    camloc=[]
    camtrg=[]
    lenses=[]
    ups=[]
    display=''
    
    f= open(trg_file,'r')
    lines=f.readlines()
    for line in lines:
        tloc,ttrg,tlens,tup=interpret_line(line)
        camloc.append(tloc)
        camtrg.append(ttrg)
        lenses.append(tlens)
        ups.append(tup)
        


O_CAMLOC=camloc
O_CAMTRG=camtrg
O_LENSES=lenses
O_UPS=ups
O_DISPLAY=get_text().split('\n')
# ---------- end python_2 ----------
panel = Panel("""10
10
10
10
10
20""")
pt_4 = Point(python_2.O_CAMLOC)
pt_5 = Point(python_2.O_CAMTRG)
num = Number(python_2.O_LENSES)
vec = Vector(python_2.O_UPS)
ghpython_script = GhPythonScript(Camloc=pt_4, Camtrg=pt_5, Lenses=num, Ups=vec, Intervals=panel, Init_t=0, Generate_toggle=Toggle(False))  # -> Out, O_CAMLOC, O_CAMTRG, O_LENSES, O_UPS
panel_2 = Panel(python_2.O_DISPLAY)
interpolate = Interpolate(Vertices=python_2.O_CAMTRG, Degree=1, Periodic=False, KnotStyle=1)  # -> Curve, Length, Domain
interpolate_2 = Interpolate(Vertices=python_2.O_CAMLOC, Degree=3, Periodic=False, KnotStyle=1)  # -> Curve, Length, Domain
syncfloundercamera = SyncFlounderCamera(
    Activate=toggle,
    ViewportName="APerspectiveSync",
    Location=ghpython_script.O_CAMLOC,
    Target=ghpython_script.O_CAMTRG,
    Lens=ghpython_script.O_LENSES,
    Up=ghpython_script.O_UPS)
