# Grasshopper definition move_mesh.gh (Grasshopper 1.0.4)

mesh = Mesh([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])
timer = Timer(TimerInterval=100, Target=python)  # disabled
pt = Point(Point(-1.532133561, -17.00479907, 16.58383444))
mjoin = MeshJoin(Meshes=mesh)
cluster = Cluster(mesh=mjoin, B=pt)
python = GhPythonScript(imesh=cluster, org=pt, run=Toggle(True))  # -> out, O_PTS, O_MESH; inputs imesh: Mesh, org: Point3d, run: Boolean
# ---------- python: Python ----------
__author__ = "seah"

import rhinoscriptsyntax as rs
from Rhino.Geometry import Mesh, Point3d, Vector3f, Point3f

TOLERANCE=0.001

def f2d(p):
    return Point3d(p.X,p.Y,p.Z)

def get_verts_from_face_index(mesh,i):
    face=mesh.Faces[i]
    p1=mesh.Vertices[face[0]]
    p2=mesh.Vertices[face[1]]
    p3=mesh.Vertices[face[2]]
    p4=mesh.Vertices[face[3]]
    return [f2d(p1),f2d(p2),f2d(p3),f2d(p4)]
def move_face(i,factor=0.3):
    face=ofaces[i]
    target=targets[i]
    for j in range(len(face)):
        p1=face[j]
        p2=target[j]
        dist=rs.Distance(p1,p2)
        if dist<0.001:
            trg=targets[i][j]
            ofaces[i][j]=Point3d(trg)
            return
        #print(p2.X)
        vect=rs.VectorUnitize(Point3d(p2.X,p2.Y,p2.Z)-p1)
        vect*=dist*factor
        #vect=Vector3f(vect[0],vect[1],vect[2])
        ofaces[i][j]=p1+vect




    
solver_max=50

if run:
#for step in range(solver_max):
    activecount=step*20
    if activecount>facecount-1:
        activecount=facecount-1

    for i in range(activecount):
        move_face(i)
        #opts.append(ofaces[i][0])
        for j in range(4):
            vi=omesh.Faces[i][j]
            p=ofaces[i][j]
            omesh.Vertices.SetVertex(vi,Point3f(p[0],p[1],p[2]))
    step+=1

else:
    omesh=Mesh()
    facecount=len(imesh.Faces)
    print(imesh.Faces[0][1])
    print(imesh.Vertices[1])
    ofaces=[]
    targets=[]
    step=0
    for i in range(facecount):
        ofaces.append([Point3d(0,0,0),Point3d(0,0,0),Point3d(0,0,0),Point3d(0,0,0)])
        targets.append(get_verts_from_face_index(imesh,i))
        for j in range(4):
            omesh.Vertices.Add(Point3d(0,0,0))
        i1=len(omesh.Vertices)
        omesh.Faces.AddFace(i1,i1+1,i1+2,i1+3)
    print(ofaces[0])
O_MESH=omesh
# ---------- end python ----------
preview = CustomPreview(
    Geometry=python.O_MESH,
    Shader={diffuse=RGB(255, 105, 180), emission=RGB(76, 32, 54), shine=0.5, specular=RGB(255, 255, 255), transparency=0})

# ==== cluster Cluster
B = ClusterInput()
mesh = ClusterInput()
mesh_2 = Mesh(mesh)
facen = FaceNormals(Mesh=mesh_2)  # -> Centers, Normals
demesh = DeconstructMesh(Mesh=mesh_2)  # -> Vertices, Faces, Colours, Normals
dist = Distance(PointA=facen.Centers, PointB=B)
sort = SortList(Keys=dist, ValuesA=demesh.Faces)  # -> Keys, ValuesA
deface = DeconstructFace(Face=sort.ValuesA)  # -> CornerA, CornerB, CornerC, CornerD
quad = MeshQuad(CornerA=deface.CornerA, CornerB=deface.CornerB, CornerC=deface.CornerC, CornerD=deface.CornerD)
conmesh = ConstructMesh(Vertices=demesh.Vertices, Faces=quad)
M = ClusterOutput(conmesh)
