# Grasshopper definition move_mesh_real.gh (Grasshopper 1.0.4)

mesh = Mesh([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])
pt = Point(Point(-1.532133561, -17.00479907, 16.58383444))
mjoin = MeshJoin(Meshes=mesh)
cluster = Cluster(mesh=mjoin, B=pt)

# ---- group: test success on manipulating rhino doc object
timer = Timer(TimerInterval=20, Target=ghpython_script)
ghpython_script = GhPythonScript(run=Toggle(False))  # -> out, a; inputs imesh: Mesh
# ---------- ghpython_script: Python ----------
__author__ = "lisi"

import rhinoscriptsyntax as rs
import Rhino
from random import Random
from Rhino.Geometry import Point3d, Vector3d, Mesh
rand=Random()

if run:
    if step==0:
        try:
            sel=rs.ObjectsByName('last_created')
            rs.DeleteObject(sel)
        except:
            pass
        global id
        id=Rhino.RhinoDoc.ActiveDoc.Objects.AddMesh(imesh)
        rs.ObjectName(id,'last_created')
    #--------------------------------------------
    mesh=rs.coercemesh(id)
    print(mesh)
    for i in range(len(mesh.Vertices)):
        vect=[]
        for j in range(3):
            vect.append(rand.randrange(-100,100)/1000)
        mvect=Vector3d(vect[0],vect[1],vect[2])
        p=mesh.Vertices[i]
        p=Point3d(p.X,p.Y,p.Z)
        p+=mvect
        if i==0:
            print(p)
        mesh.Vertices[i]=Rhino.Geometry.Point3f(p[0],p[1],p[2])
    #the key to update the gemotry is this replace methos!
    Rhino.RhinoDoc.ActiveDoc.Objects.Replace(id,mesh)
    step+=1
    pass
else:
    step=0
    id=None
    print(id)
# ---------- end ghpython_script ----------

# ----
timer_2 = Timer(TimerInterval=100, Target=python)
python = GhPythonScript(imesh=cluster, org=pt, run=Toggle(False))  # -> out, O_PTS, O_MESH; inputs imesh: Mesh, org: Point3d, run: Boolean
# ---------- python: Python ----------
__author__ = "seah"
import Rhino
import rhinoscriptsyntax as rs
import scriptcontext as sc
from Rhino.Geometry import Mesh, Point3d, Vector3f, Point3f
from random import Random

rand=Random()
TOLERANCE=0.001

def f2d(p):
    return Point3d(p.X,p.Y,p.Z)

def get_verts_from_face_index(mesh,i):
    face=mesh.Faces[i]
    p1=mesh.Vertices[face[0]]
    p2=mesh.Vertices[face[1]]
    p3=mesh.Vertices[face[2]]
    p4=mesh.Vertices[face[3]]
    return [f2d(p1),f2d(p2),f2d(p3),f2d(p4)]
def move_face(i,factor=0.3):
    face=ofaces[i]
    target=targets[i]
    for j in range(len(face)):
        p1=face[j]
        p2=target[j]
        dist=rs.Distance(p1,p2)
        if dist<0.001:
            trg=targets[i][j]
            ofaces[i][j]=Point3d(trg)
            return
        #print(p2.X)
        vect=rs.VectorUnitize(Point3d(p2.X,p2.Y,p2.Z)-p1)
        vect*=dist*factor
        #vect=Vector3f(vect[0],vect[1],vect[2])
        ofaces[i][j]=p1+vect




    
solver_max=50
name='gh_generated_obj'
if run:
    if step==0:
        
        print('0 step')
        try:
            sel=rs.ObjectsByName(name)
            rs.DeleteObjects(sel)
            print('object deleted')
        except Exception as e:
            pass
        global id
        id=Rhino.RhinoDoc.ActiveDoc.Objects.AddMesh(omesh)
        print(id)

        
    activecount=step*20
    if activecount>facecount-1:
        activecount=facecount-1

    for i in range(activecount):
        move_face(i)
        #opts.append(ofaces[i][0])
        for j in range(4):
            vi=omesh.Faces[i][j]
            p=ofaces[i][j]
            omesh.Vertices.SetVertex(vi,Point3f(p[0],p[1],p[2]))
    try:
        rs.ObjectName(id,name)
    except:
        pass
    Rhino.RhinoDoc.ActiveDoc.Objects.Replace(id,omesh)
    
    step+=1

else:
    omesh=Mesh()
    facecount=len(imesh.Faces)
    print(imesh.Faces[0][1])
    print(imesh.Vertices[1])
    ofaces=[]
    targets=[]
    step=0
    id=None
    for i in range(facecount):
        ofaces.append([Point3d(0,0,0),Point3d(0,0,0),Point3d(0,0,0),Point3d(0,0,0)])
        targets.append(get_verts_from_face_index(imesh,i))
        z=-1000
        omesh.Vertices.Add(Point3d(0,0,z))
        omesh.Vertices.Add(Point3d(1,0,z))
        omesh.Vertices.Add(Point3d(1,1,z))
        omesh.Vertices.Add(Point3d(0,1,z))
        i1=len(omesh.Vertices)-4
        omesh.Faces.AddFace(i1,i1+1,i1+2,i1+3)
    print(ofaces[0])
O_MESH=omesh
# ---------- end python ----------
timer_3 = Timer(TimerInterval=200)

# ==== cluster Cluster
mesh = ClusterInput()
mesh_2 = Mesh(mesh)
facen = FaceNormals(Mesh=mesh_2)  # -> Centers, Normals
demesh = DeconstructMesh(Mesh=mesh_2)  # -> Vertices, Faces, Colours, Normals
B = ClusterInput()
dist = Distance(PointA=facen.Centers, PointB=B)
sort = SortList(Keys=dist, ValuesA=demesh.Faces)  # -> Keys, ValuesA
deface = DeconstructFace(Face=sort.ValuesA)  # -> CornerA, CornerB, CornerC, CornerD
quad = MeshQuad(CornerA=deface.CornerA, CornerB=deface.CornerB, CornerC=deface.CornerC, CornerD=deface.CornerD)
conmesh = ConstructMesh(Vertices=demesh.Vertices, Faces=quad)
M = ClusterOutput(conmesh)
