# Grasshopper definition site.gh (Grasshopper 1.0.4)

series = Series(Start=0, Step=1, Count=30)
srf = Surface(<surface referenced from the Rhino model>)
Z = UnitZ(Factor=expr("x*3", series))
brep = Brep([<brep referenced from the Rhino model> x11])
mplane = MeshPlane(Boundary=srf, WidthCount=50, HeightCount=50)  # -> Mesh, Area
move = Move(Geometry=mplane.Mesh, Motion=Z)  # -> Geometry, Transform
demesh = DeconstructMesh(Mesh=move.Geometry)  # -> flatten(Vertices), Faces, Colours, Normals
pt = Point(demesh.Vertices)
brepsinc = PointInBreps(Brep=flatten(brep), Point=pt, Strict=False)  # -> Inside, Index
dispatch = Dispatch(List=pt, DispatchPattern=brepsinc.Inside)  # -> ListA, ListB
pt_2 = Point(dispatch.ListA)
pt_3 = Point(dispatch.ListB)
sph = Sphere(Base=pt_2, Radius=0.5)
sph_2 = Sphere(Base=pt_3, Radius=0.1)
preview = CustomPreview(
    Geometry=sph_2,
    Shader={diffuse=RGB(255, 105, 180), emission=RGB(76, 32, 54), shine=0.5, specular=RGB(255, 255, 255), transparency=0})
