# Grasshopper definition wind.gh (Grasshopper 1.0.4)

mesh = Mesh(<mesh referenced from the Rhino model>)
pt = Point(<point referenced from the Rhino model>)
pt_2 = Point(<point referenced from the Rhino model>)
demesh = DeconstructMesh(Mesh=mesh)  # -> Vertices, Faces, Colours, Normals
brep = Brep([<brep referenced from the Rhino model> x3])
vec2pt = Vector2Pt(PointA=pt_2, PointB=pt, Unitize=False)  # -> Vector, Length
unit = UnitVector(Vector=vec2pt.Vector)
cluster = Cluster(B=brep, pt=demesh.Vertices)  # -> pt_4, num_2
pt_3 = Point(graft(demesh.Vertices))
brep_2 = Brep(flatten(brep))
amp = Amplitude(Vector=flatten(unit), Amplitude=200)
amp_2 = Amplitude(Vector=unit, Amplitude=10)
color_scale = ColorScale(N=cluster.num_2)
vdisex = VectorDisplayEx(Point=pt_2, Vector=amp_2, Colour=RGB(0, 0, 0), Width=2)
line = Line()
pt_4 = Point(flatten(<point referenced from the Rhino model>))
preview = CustomPreview(Geometry=cluster.pt_4, Shader=color_scale)
pt_5 = Point(flatten(pt_3))
python = GhPythonScript(ipt=pt_3, ibreps=brep_2, ivect=amp)  # -> out, O_DIST, O_PTS; inputs ipt: Point3d, ibreps: list of Brep, ivect: Vector3d
# ---------- python: Python ----------
__author__ = "seah"

import rhinoscriptsyntax as rs
import Rhino

op=rs.VectorAdd(ipt,ivect)
od=rs.Distance(ipt,op)
pts=Rhino.Geometry.Intersect.Intersection.ProjectPointsToBreps(ibreps,[ipt],ivect,0.1)
print(pts)


for p in pts:
    d=rs.Distance(ipt,p)
    if d<od:
        od=d
        op=p
O_DIST=od
O_PTS=op
# ---------- end python ----------
eval = Evaluate(F="x+y", x=python.O_DIST, y=cluster.num_2)
color_scale_2 = ColorScale(N=eval)  # -> flatten(C)
preview_2 = CustomPreview(Geometry=pt_5, Shader=color_scale_2)
color_scale_3 = ColorScale(N=python.O_DIST)  # -> flatten(C)
ln = Line(StartPoint=pt_3, EndPoint=python.O_PTS)  # -> flatten(Line)
preview_3 = CustomPreview(Geometry=pt_5, Shader=color_scale_3)

# ==== cluster ColorScale
N = ClusterInput()
bnd = Bounds(Numbers=flatten(N))
dedomain = DeconstructDomain(Domain=bnd)  # -> Start, End
gradient = Gradient(
    LowerLimit=dedomain.Start,
    UpperLimit=dedomain.End,
    Parameter=flatten(N),
    stops=[0: RGB(234, 38, 0), 0.152: RGB(234, 126, 0), 0.36: RGB(254, 244, 84), 0.641: RGB(173, 203, 249), 1: RGB(75, 107, 169)])
C = ClusterOutput(gradient)

# ==== cluster Cluster
pt = ClusterInput()
B = ClusterInput()
pt_2 = Point(pt)
debrep = DeconstructBrep(Brep=B)  # -> Faces, Edges, Vertices
srf_cp = SurfaceClosestPoint(Point=graft(pt_2), Surface=flatten(debrep.Faces))  # -> Point, UVPoint, Distance
bnd = Bounds(Numbers=srf_cp.Distance)
dedomain = DeconstructDomain(Domain=bnd)  # -> Start, End
num = Number(dedomain.Start)
pt_3 = Point(pt_2)
num_2 = ClusterOutput(num)
pt_4 = ClusterOutput(pt_3)
