# Grasshopper definition wind2.gh (Grasshopper 0.9.76)
# plug-ins: Python Interpreter

level = Slider(26, range=0..60)

# ---- group: direction
pt = Point(<point referenced from the Rhino model>)
pt_2 = Point(<point referenced from the Rhino model>)
vec2pt = Vector2Pt(PointA=pt, PointB=pt_2, Unitize=False)  # -> Vector, Length
vdis = VectorDisplay(Anchor=pt, Vector=vec2pt.Vector)

# ---- group: floor grid
mesh = Mesh(<mesh referenced from the Rhino model>)
Z = UnitZ(Factor=level)
move = Move(Geometry=mesh, Motion=Z)  # -> Geometry, Transform
demesh = DeconstructMesh(Mesh=move.Geometry)  # -> Vertices, Faces, Colours, Normals

# ---- group: test point
pt_3 = Point(<point referenced from the Rhino model>)
move_2 = Move(Geometry=pt_3, Motion=Z)  # -> Geometry, Transform
amp = Amplitude(Vector=vec2pt.Vector, Amplitude=100)
pt_4 = Point(move_2.Geometry)
move_3 = Move(Geometry=pt_4, Motion=amp)  # -> Geometry, Transform

# ----
timer = Timer(TimerInterval=1000, Target=python)
mesh_2 = Mesh([<mesh referenced from the Rhino model> x11])

# ---- group: site building mesh
mesh_3 = Mesh([<mesh referenced from the Rhino model> x12])
mjoin = MeshJoin(Meshes=mesh_2)

# ----
series = Series(Start=0, Step=10, Count=5)
unit = UnitVector(Vector=vec2pt.Vector)
brep = Brep([<brep referenced from the Rhino model> x12])
python = GhPythonScript(run=Toggle(False))  # -> out, a
# ---------- python: Python ----------
__author__ = "seah"

import rhinoscriptsyntax as rs
import scriptcontext as sc
import Rhino


tFileName = "C:\\frames\\Image{}.jpg".format(0)
print(tFileName)
if run and m < 9:
    #print(m,k)
    if animate == 100 : animate = 0
    animate = animate + 2
    if animate == 50 : 
        sc.doc = Rhino.RhinoDoc.ActiveDoc
        rs.LayerVisible("%s" % m, False)
        if m < 8:
            rs.LayerVisible("%s" % (m+1), True)
        m = m + 1
        sc.doc = ghdoc
    if animate % 2 == 0 : 
        FileName = "C:\\frames\\Image{}.jpg".format(k)
        print(FileName)
        #command="_-ViewCaptureToFile " + " _Enter _" +  FileName  + " _Enter" + " _Enter"
        command="_-ViewCaptureToFile _"+FileName  + " _Enter"
        print(command)
        rs.Command(command, 0)
        k += 1
else :
    animate = 0
    m = 0
    k = 0
    
a = animate/100
# ---------- end python ----------
Z_2 = UnitZ(Factor=series)
points_outside_brep = PointsOutsideBrep(B=brep, P=demesh.Vertices)
python_2 = GhPythonScript()  # -> out, a
# ---------- python_2: Python ----------
__author__ = "seah"

import rhinoscriptsyntax as rs

name="c:\\frames\\wala"
print(name)
# ---------- end python_2 ----------
panel = Panel(python.out)
move_4 = Move(Geometry=move.Geometry, Motion=Z_2)  # -> Geometry, Transform
pt_5 = Point(<point referenced from the Rhino model>)
crv = Curve(<curve referenced from the Rhino model>)
pt_6 = Point(points_outside_brep)
number_slider = Slider(5, range=0..50)
timer_2 = Timer(TimerInterval=100)
demesh_2 = DeconstructMesh(Mesh=move_4.Geometry)  # -> Vertices, Faces, Colours, Normals
divide = DivideCurve(Curve=crv, Count=50, Kinks=False)  # -> Points, Tangents, Parameters
python_3 = GhPythonScript(ipt=pt_6, imesh=mjoin, ivect=unit, amp=number_slider, ray_amp=Slider(105.619, range=0..200))  # -> out, O_DIST, O_PT, O_DEFLECT, O_VECT, O_PS, O_NG; inputs ipt: Point3d, imesh: Mesh, ivect: Vector3d
# ---------- python_3: Python ----------
__author__ = "seah"
import Rhino
from Rhino.Geometry import Point3d, Vector3d
import rhinoscriptsyntax as rs

thresh=500
left=rs.VectorCrossProduct(ivect,(0,0,1))
right=-left
odeflect=None
opossitive=[]
onegative=[]

def getDistPts(ipt,ivect,imesh,recursive=True):
    deflect=None
    p2=rs.VectorAdd(ipt,rs.VectorScale(ivect,ray_amp))
    dist=ray_amp
    ray=Rhino.Geometry.Ray3d(ipt,ivect)
    t=Rhino.Geometry.Intersect.Intersection.MeshRay(imesh,ray)
    if t>=0:
        ptx=ray.PointAt(t)
        print(ptx)
        p2=ptx
        dist=rs.Distance(ipt,p2)
    if dist>thresh:
        dist=thresh
        
    #recursive to analyize deflection direction
    if recursive:
        ript=ipt+(right*0.01)
        rdist,rp2,temp=getDistPts(ript,ivect,imesh,False)
        if rdist>dist:
            deflect=right
        else:
            deflect=left
    if recursive:
        return (dist*dist/500),p2,deflect
    else:
        return dist,p2,deflect
    
possitive,p2,p_deflect=getDistPts(ipt,ivect,imesh)
negative,p3,n_deflect=getDistPts(ipt,-ivect,imesh)

if possitive is not None and possitive<negative:
    sign=1
    if False:
    #if n_deflect is not None:
        deflect=p_deflect+n_deflect
    else: 
        deflect=p_deflect
    dist=possitive
    opossitive.append(ipt)
elif negative is None or negative<possitive:
    sign=-1
    deflect=-n_deflect
    dist=negative
    onegative.append(ipt)
else:
    sign=0
    deflect=Vector3d(0,0,0)
    dist=0

factor=dist if dist>=1 else 1
factor*=1.3
deflect/=factor
deflect=deflect if rs.VectorLength(deflect)<1 else rs.VectorUnitize(deflect)

ovect=(ivect+deflect)*amp
#ovect=(ivect*amp)

dist=possitive-negative

O_PT=p2
O_DIST=dist
O_DEFLECT=p_deflect
O_VECT=ovect

O_PS=opossitive
O_NG=onegative
# ---------- end python_3 ----------
c_script = CSharpScript(ipt=pt_5, reset=Button())  # -> out, A; inputs ipt: Point3d, reset: Boolean
# ---------- c_script: C# ----------
    if (reset){
      Print("reset");
      objPt = ipt;
      step = 0;
    }
    Print("step" + step.ToString());
    step += 1;
    objPt += new Vector3d(1, 0, 0);
    A = objPt;
# ---------- c_script: C# additional code ----------
  int step = 0;
  Point3d objPt = new Point3d();
# ---------- end c_script ----------
ln = Line(StartPoint=python_3.O_PT, EndPoint=pt_6)
panel_2 = Panel(c_script.out)
pt_7 = Point(pt_6)

bnd = Bounds(Numbers=python_3.O_DIST)
dedomain = DeconstructDomain(Domain=bnd)  # -> Start, End
gradient = Gradient(
    LowerLimit=dedomain.Start,
    UpperLimit=dedomain.End,
    Parameter=python_3.O_DIST,
    stops=[0: RGB(234, 38, 0), 0.25: RGB(234, 126, 0), 0.5: RGB(254, 244, 84), 0.75: RGB(173, 203, 249), 1: RGB(75, 107, 169)])

col = Colour(RGB(13, 182, 255))
vdis_2 = VectorDisplay(Anchor=pt_6, Vector=python_3.O_VECT)
eval = Evaluate(F="1-(x/y)", x=python_3.O_DIST, y=dedomain.End)
panel_3 = Panel(eval)
preview = CustomPreview(Geometry=pt_6, Shader=gradient)
average_vector_field = Average_Vector_Field(vec=python_3.O_VECT, pt=python_3.O_VECT)  # -> am, pt_5
average_vector_field_2 = Average_Vector_Field(vec=average_vector_field.am, pt=average_vector_field.pt_5)  # -> am, pt_5
display_path = DisplayPath(V=average_vector_field_2.am, G=pt_6, A=number_slider)  # -> G_3, L, G_2
pt_8 = Point(display_path.G_3)
pt_9 = Point(display_path.G_3)
cps = ClosestPoints(Point=pt_8, Cloud=flatten(pt_9), Count=2)  # -> ClosestPoint, CPIndex, Distance
bnd_2 = Bounds(Numbers=cps.Distance)
dedomain_2 = DeconstructDomain(Domain=bnd_2)  # -> Start, flatten(End)
bnd_3 = Bounds(Numbers=dedomain_2.End)
panel_4 = Panel(dedomain_2.End)
dedomain_3 = DeconstructDomain(Domain=bnd_3)  # -> Start, End
gradient_2 = Gradient(
    LowerLimit=dedomain_3.Start,
    UpperLimit=6,
    Parameter=dedomain_2.End,
    stops=[0: RGB(234, 38, 0), 0.25: RGB(234, 126, 0), 0.5: RGB(254, 244, 84), 0.75: RGB(173, 203, 249), 1: RGB(75, 107, 169)])
preview_2 = CustomPreview(Geometry=flatten(pt_8), Shader=flatten(gradient_2))
vdisex = VectorDisplayEx(Point=display_path.G_2, Vector=python_3.O_VECT, Colour=gradient_2, Width=2)
crv_2 = Curve(display_path.L)
preview_3 = CustomPreview()
curvepoint = PointOnCurve(parameter=0.829)
vec_averaged = Vector(average_vector_field_2.am)
pyparticle = GhPythonScript(ipts=flatten(divide.Points), run=Toggle(False), field_pts=flatten(pt_6), field_vects=flatten(vec_averaged), interval=10)  # -> out, O_P, O_TRAIL, O_SEGMENTS, O_VECTS, O_SPLINE, OPOLY; inputs ipts: list of Point3d, field_pts: list of Point3d, field_vects: list of Vector3d
# ---------- pyparticle: Python ----------
__author__ = "seah"

from Rhino.Geometry import Line, LineCurve, Point3d, Vector3d
import rhinoscriptsyntax as rs

def points_closest_point(p,pts):
    cp=pts[0]
    cd=rs.Distance(p,cp)
    ci=0
    for i in range(len(pts)):
        tp=pts[i]
        d=rs.Distance(p,tp)
        if d<cd:
            cd=d
            cp=tp
            ci=i
    return cp,cd,ci



if run:
    for i in range(len(opts)):
        op=opts[i]
        last_pt=last_pts[i]
        
        cp,cd,ci=points_closest_point(op,field_pts)
        if cd<30:
            #difvect=field_vects[ci]-last_vects[i]
            #vect=last_vects[i]+(difvect)
            vect=field_vects[ci]
            op+=(vect/5)
            display_vect=rs.VectorSubtract(op,last_pt)
            ovects.append(display_vect)
            opts[i]=op
            otrail.append(op)
        
        if rs.Distance(op,last_pt)>1 and step%interval==0:
            ls=last_pt
            le=op
            lc=LineCurve(ls,le)
            last_pts[i]=op
            osegments.append(lc)
        
    
    O_VECTS=ovects
    O_P=opts
    O_TRAIL=otrail
    O_SEGMENTS=osegments
    
else:
    opts=[]
    ovects=[]
    last_pts=[]
    last_vects=[]
    
    for ipt in ipts:
        opts.append(ipt)
        last_pts.append(ipt)
    for vect in field_vects:
        last_vects.append(vect)
    step=0
    osegments=[]
    otrail=[]
# ---------- end pyparticle ----------
divide_2 = DivideCurve(Curve=pyparticle.O_TRAIL, Count=10, Kinks=False)  # -> Points, Tangents, Parameters
panel_5 = Panel(pyparticle.out)
crv_3 = Curve(pyparticle.O_SEGMENTS)
pt_10 = Point(pyparticle.O_P)
preview_4 = CustomPreview(Geometry=crv_3, Shader=col)
vdisex_2 = VectorDisplayEx(Point=pyparticle.O_P, Vector=pyparticle.O_VECTS, Colour=col, Width=3)
vec = Vector(vec_averaged)
cluster = Cluster(V=vec, C=crv_2, run=Toggle(False))
vdisex_3 = VectorDisplayEx(Point=cluster, Vector=vec, Colour=gradient_2, Width=2)
vdisex_4 = VectorDisplayEx(Point=average_vector_field.pt_5, Vector=vec_averaged, Colour=gradient_2, Width=2)

# ==== cluster Average_Vector_Field
vec = ClusterInput()
pt = ClusterInput()
vec_2 = Vector(vec)
pt_2 = Point(pt)
pt_3 = Point(flatten(pt_2))
pt_4 = Point(graft(pt_2))
pt_5 = ClusterOutput(pt_3)
cps = ClosestPoints(Point=pt_4, Cloud=pt_3, Count=3)  # -> ClosestPoint, CPIndex, Distance
item = ListItem(List=vec_2, Index=cps.CPIndex, Wrap=True)
avr = Average(Input=item)  # -> flatten(ArithmeticMean)
am = ClusterOutput(avr)

# ==== cluster DisplayPath
G = ClusterInput()
V = ClusterInput()
A = ClusterInput()
amp = Amplitude(Vector=expr("-x", V), Amplitude=expr("x/2", A))
move = Move(Geometry=G, Motion=amp)  # -> Geometry, Transform
move_2 = Move(Geometry=move.Geometry, Motion=V)  # -> Geometry, Transform
G_2 = ClusterOutput(move.Geometry)
G_3 = ClusterOutput(move_2.Geometry)
ln = Line(StartPoint=move.Geometry, EndPoint=move_2.Geometry)
L = ClusterOutput(ln)

# ==== cluster PointsOutsideBrep
B = ClusterInput()
P = ClusterInput()
brepsinc = PointInBreps(Brep=B, Point=P, Strict=False)  # -> Inside, Index
dispatch = Dispatch(List=P, DispatchPattern=brepsinc.Inside)  # -> ListA, ListB
B_2 = ClusterOutput(dispatch.ListB)

# ==== cluster Cluster
run = ClusterInput()
C = ClusterInput()
V = ClusterInput()
python = GhPythonScript(run=run)  # -> out, O_T1, O_AMP1, O_T2, O_AMP2; inputs run: Boolean
# ---------- python: Python ----------
__author__ = "seah"

import rhinoscriptsyntax as rs
step=0.1
amp=0.5

def iter(num):
    num+=step
    if num>1:
        num=0
    return num
    
def get_amp(t1,t2):
    if t2-t1>0.5:
        return 0.5
    else: 
        return (t2-t1)


if run :
    t1=iter(t1)
    amp1=get_amp(t1,1)
    t2=iter(t2)
    amp2=get_amp(t2,1)
    
    O_T1=t1
    O_AMP1=amp1
    O_T2=t2
    O_AMP2=amp2
    
else:
    t1=0.0
    t2=0.5
# ---------- end python ----------
timer = Timer(TimerInterval=100, Target=python)
amp = Amplitude(Vector=V, Amplitude=python.O_AMP1)
eval = EvaluateCurve(Curve=C, Parameter=python.O_T1)  # -> Point, Tangent, Angle
P = ClusterOutput(eval.Point)
