# Grasshopper definition wind_rh5.gh (Grasshopper 0.9.76)
# plug-ins: Python Interpreter

xy_plane = XYPlane(Origin=Point(0, 0, 0))
level = Slider(35, range=0..60)
mesh = Mesh([<mesh referenced from the Rhino model> x11])
brep = Brep([<brep referenced from the Rhino model> x12])
srf = Surface(<surface referenced from the Rhino model>)
mjoin = MeshJoin(Meshes=mesh)
gen_grid = Gen_grid(S=srf, U="60", V="40")
cluster = Cluster(D=Slider(204, range=0..360))
elevate_pts = Elevate_pts(G=gen_grid, F=level)
elevate_pts_2 = Elevate_pts(G=xy_plane, F=level)
vec = Vector(cluster)
plane = Plane(elevate_pts_2)
pt_grid = Point(elevate_pts)
points_outside_brep = PointsOutsideBrep(B=brep, P=pt_grid)
pt = Point(points_outside_brep)
limits = Slider(60, range=0..100)
vec_2 = Vector(vec)
pt_grid_2 = Point(pt)
mesh_2 = Mesh(mjoin)
pt_grid_3 = Point(pt)
mesh_3 = Mesh(mjoin)
plane_2 = Plane(plane)
pts_closest_mesh = Pts_closest_mesh(pt_grid=pt_grid_3, mesh=mesh_3, plane=plane_2)  # -> pt_grid_3, S, E, o_dist

# ---- group: test on particle repel
mesh_4 = Mesh(<mesh referenced from the Rhino model>)
crv = Curve(<curve referenced from the Rhino model>)
elevate_pts_3 = Elevate_pts(G=crv, F=level)
divide_curve = DivideCurve(Curve=elevate_pts_3, Count=10, Kinks=False)  # -> Points, Tangents, Parameters
deconstruct_mesh = DeconstructMesh(Mesh=mesh_4)  # -> Vertices, Faces, Colours, Normals
vec_3 = Vector(vec)
timer = Timer(TimerInterval=50, Target=python_script)  # disabled
python_script = PythonScript(ipts=flatten(deconstruct_mesh.Vertices), run=Toggle(False), wind_vect=vec_3, wind_amp="0.1")  # -> out, O_PTS; inputs ipts: list of Point3d, run: Boolean, wind_vect: Vector3d
# ---------- python_script: Python ----------
import rhinoscriptsyntax as rs

def repel(p1,pts,r=6,factor=1):
    for i in range(len(pts)):
        p2=pts[i]
        dist=rs.Distance(p1,p2)
        if dist<0.0001: 
            continue
        if dist<r:
            deflect=rs.VectorUnitize(p1-p2)
            print(p1)
            deflect=rs.VectorScale(deflect,dist/r)
            deflect[2]=0
            p1+=(deflect/2)*factor
            p2-=(deflect/5)*factor
            pts[i]=p2
            
    return p1
    

if run:
    for i in range(len(opts)):
        op=opts[i]
        print(wvect)
        op+=wvect
        op=repel(op,opts)
        opts[i]=op
        pass
    O_PTS=opts
else:
    opts=ipts
    wvect=wind_vect*wind_amp
# ---------- end python_script ----------
point = Point(python_script.O_PTS)

# ----
python = GhPythonScript(ipt=pt_grid_2, imesh=mesh_2, ivect=vec_2, amp=Slider(5, range=0..50), ray_amp=Slider(135.204, range=0..200))  # -> out, O_DIST, O_PT, O_DEFLECT, O_VECT, O_PS, O_NG; inputs ipt: Point3d, imesh: Mesh, ivect: Vector3d
# ---------- python: Python ----------
__author__ = "seah"
import Rhino
from Rhino.Geometry import Point3d, Vector3d
import rhinoscriptsyntax as rs

thresh=ray_amp
left=rs.VectorCrossProduct(ivect,(0,0,1))
right=-left
odeflect=None
opossitive=[]
onegative=[]

def getDistPts(ipt,ivect,imesh,recursive=True):

    deflect=None
    p2=rs.VectorAdd(ipt,rs.VectorScale(ivect,thresh))
    dist=None
    ray=Rhino.Geometry.Ray3d(ipt,ivect)
    t=Rhino.Geometry.Intersect.Intersection.MeshRay(imesh,ray)
    if t>=0:
        ptx=ray.PointAt(t)
        print(ptx)
        p2=ptx
        dist=rs.Distance(ipt,p2)
        if dist>thresh:
            dist=thresh
            
    print(dist)
    #recursive to analyize deflection direction
    if recursive:
        ript=ipt+(right*0.01)
        rdist,rp2,temp=getDistPts(ript,ivect,imesh,False)
        if rdist>dist:
            deflect=right
        else:
            deflect=left
        if dist:
            return dist,p2,deflect
        else:
            return None,p2,deflect
    else:
        return dist,p2,deflect
    
possitive,p2,p_deflect=getDistPts(ipt,ivect,imesh)
negative,p3,n_deflect=getDistPts(ipt,-ivect,imesh)

sign=1
if possitive is not None and negative is not None:
    dist=possitive-negative###
    dist=thresh-dist
    if possitive>negative:
        deflect=p_deflect
        opossitive.append(ipt)
    elif possitive<negative:
        deflect=p_deflect
        onegative.append(ipt)
        dist=possitive-negative###
        sign=-1
    else:
        deflect=Vector3d(0,0,0)
        dist=0
        
elif negative is None and possitive is not None:
        deflect=p_deflect
        opossitive.append(ipt)
        dist=thresh-possitive ###
elif possitive is None and negative is not None:
        deflect=n_deflect
        opossitive.append(ipt)
        dist=thresh-negative###
        sign=-0.3
else:
    dist=0
    deflect=Vector3d(0,0,0)

dist=(dist*dist)/(thresh*thresh)*sign
factor*=1.3
deflect/=factor
deflect=deflect if rs.VectorLength(deflect)<1 else rs.VectorUnitize(deflect)

ovect=(ivect+deflect)*amp
#ovect=(ivect*amp)



O_PT=p2
O_DIST=dist
O_DEFLECT=p_deflect
O_VECT=ovect

O_PS=opossitive
O_NG=onegative
# ---------- end python ----------

# ---- group: old_animate_stream
crv_2 = Curve(<curve referenced from the Rhino model>)
elevate_pts_4 = Elevate_pts(G=crv_2, F=level)
divide = DivideCurve(Curve=elevate_pts_4, Count=30, Kinks=False)  # -> Points, Tangents, Parameters
vec_4 = Vector(python.O_VECT)
pt_grid_4 = Point(pt)
timer_2 = Timer(TimerInterval=100, Target=pyparticle)
pyparticle = GhPythonScript(ipts=flatten(divide.Points), run=Toggle(False), field_pts=flatten(pt_grid_4), field_vects=flatten(vec_4), interval=40)  # -> out, O_P, O_TRAIL, O_SEGMENTS, O_VECTS, O_SPLINE, OPOLY; inputs ipts: list of Point3d, field_pts: list of Point3d, field_vects: list of Vector3d
# ---------- pyparticle: Python ----------
__author__ = "seah"

from Rhino.Geometry import Line, LineCurve, Point3d, Vector3d
import rhinoscriptsyntax as rs

def repel(p1,pts,r=10,factor=1):
    for i in range(len(pts)):
        p2=pts[i]
        dist=rs.Distance(p1,p2)
        if dist<0.0001: 
            continue
        if dist<r:
            deflect=rs.VectorUnitize(p1-p2)
            print(p1)
            deflect=rs.VectorScale(deflect,(dist*dist)/(r*r))
            deflect[2]=0
            p1+=(deflect/2)*factor
            p2-=(deflect/5)*factor
            pts[i]=p2
            
    return p1
    

def points_closest_point(p,pts):
    cp=pts[0]
    cd=rs.Distance(p,cp)
    ci=0
    for i in range(len(pts)):
        tp=pts[i]
        d=rs.Distance(p,tp)
        if d<cd:
            cd=d
            cp=tp
            ci=i
    return cp,cd,ci



if run:
    for i in range(len(opts)):
        if end_conds[i]:
            continue
        op=opts[i]
        last_pt=last_pts[i]
        
        cp,cd,ci=points_closest_point(op,field_pts)
        if cd<30:
            #difvect=field_vects[ci]-last_vects[i]
            #vect=last_vects[i]+(difvect)
            vect=field_vects[ci]
            op+=(vect/5)
            op=repel(op,otrail)
            display_vect=rs.VectorSubtract(op,last_pt)
            ovects.append(display_vect)
            opts[i]=op
            otrail.append(op)
        else:
            end_conds[i]=True
        
        if rs.Distance(op,last_pt)>1 and step%interval==0:
            ls=last_pt
            le=op
            lc=LineCurve(ls,le)
            last_pts[i]=op
            osegments.append(lc)
        
    
    O_VECTS=ovects
    O_P=opts
    O_TRAIL=otrail
    O_SEGMENTS=osegments
    
else:
    end_conds=[False]*len(ipts)
    opts=[]
    ovects=[]
    last_pts=[]
    last_vects=[]
    
    for ipt in ipts:
        opts.append(ipt)
        last_pts.append(ipt)
    for vect in field_vects:
        last_vects.append(vect)
    step=0
    osegments=[]
    otrail=[]
# ---------- end pyparticle ----------
divide_2 = DivideCurve(Curve=pyparticle.O_TRAIL, Count=10, Kinks=False)  # -> Points, Tangents, Parameters
panel = Panel(pyparticle.out)
col = Colour(RGB(13, 182, 255))
crv_3 = Curve(pyparticle.O_SEGMENTS)
pt_2 = Point(pyparticle.O_P)
preview = CustomPreview(Geometry=crv_3, Shader=col)
vdisex = VectorDisplayEx(Point=pyparticle.O_P, Vector=pyparticle.O_VECTS, Colour=col, Width=4)

# ----
python_2 = PythonScript(x=pts_closest_mesh.o_dist, xlim="30", y=python.O_DIST, ylim=limits)  # -> out, O_SCORE
# ---------- python_2: Python ----------
def cap(num,lim):
    if num>lim:
        num=lim
    if num<-lim:
        num=-lim
    return num

def unit(num,lim):
    return num/lim
    


#x=unit(cap(x,xlim),xlim)
#x=xlim-x
y=unit(cap(y,ylim),ylim)

if x<xlim:
    x=xlim-x
    if y>0:
        sign=1
        x=(1-unit(x,xlim))*0.6
        y*=1
    else:
        sign=-1
        x=(1-(unit(x,xlim)*1))*-1

    
else:
    x=0
x*=1
y*=0.8
O_SCORE=x+y
# ---------- end python_2 ----------
bnd = Bounds(Numbers=python_2.O_SCORE)
gradient = Gradient(
    LowerLimit=pts_closest_mesh.S,
    UpperLimit="30",
    Parameter=pts_closest_mesh.o_dist,
    stops=[0: RGB(234, 38, 0), 0.242: RGB(234, 126, 0), 0.489: RGB(254, 244, 84), 0.698: RGB(173, 203, 249), 1: RGB(75, 107, 169)])
gradient_2 = Gradient(
    LowerLimit=-2,
    UpperLimit=2,
    Parameter=python_2.O_SCORE,
    stops=[0: RGB(234, 38, 0), 0.242: RGB(234, 126, 0), 0.489: RGB(255, 255, 255), 0.698: RGB(173, 203, 249), 1: RGB(75, 107, 169)])
gradient_3 = Gradient(
    LowerLimit=expr("-x", "1"),
    UpperLimit="1",
    Parameter=python.O_DIST,
    stops=[0: RGB(234, 38, 0), 0.25: RGB(234, 126, 0), 0.5: RGB(254, 244, 84), 0.75: RGB(173, 203, 249), 1: RGB(75, 107, 169)])
bnd_2 = Bounds(Numbers=python.O_DIST)
pt_3 = Point(python.O_PS)
pt_4 = Point(python.O_NG)
preview_2 = CustomPreview(Geometry=pts_closest_mesh.pt_grid_3, Shader=gradient)
col_2 = Colour(gradient_2)

# ---- group: animate_vectors
disp_amp = Slider(15, range=0..30)
display_path = DisplayPath(V=python.O_VECT, G=pt_grid_2, A=disp_amp)  # -> G_3, L, G_2
timer_3 = Timer(TimerInterval=100, Target=cluster_2)
cluster_2 = Cluster_2(V=display_path.G_2, C=display_path.L, run=Toggle(False))
amp = Amplitude(Vector=python.O_VECT, Amplitude=5)
vdisex_2 = VectorDisplayEx(Point=cluster_2, Vector=amp, Colour=col_2, Width=2)

# ----
vdisex_3 = VectorDisplayEx(Vector=python.O_VECT, Colour=gradient_3, Width=2)
preview_3 = CustomPreview(Geometry=pt_grid_2, Shader=gradient_2)
preview_4 = CustomPreview(Geometry=pt_grid_2, Shader=gradient_3)

point_2 = Point(divide.Points)
pt_grid_5 = Point(pt)
number = Number(python_2.O_SCORE)
vec_5 = Vector(vec)
pyflow2 = PythonScript(
    ipts=flatten(point_2),
    run=Toggle(False),
    field_pts=flatten(pt_grid_5),
    field_weights=flatten(number),
    wind_vect=vec_5,
    wind_amp="2",
    interval=10)  # -> O_PTS, O_TRAIL; inputs ipts: list of Point3d, run: Boolean, field_pts: list of Point3d, field_weights: list, field_vects: list of Vector3d, wind_vect: Vector3d, interval: Int32
# ---------- pyflow2: Python ----------
__author__ = "seah"

from Rhino.Geometry import Line, LineCurve, Point3d, Vector3d
import rhinoscriptsyntax as rs

def repel(p1,pts,r=6,factor=1):
    for i in range(len(pts)):
        p2=pts[i]
        dist=rs.Distance(p1,p2)
        if dist<0.0001: 
            continue
        if dist<r:
            deflect=rs.VectorUnitize(p1-p2)
            print(p1)
            deflect=rs.VectorScale(deflect,dist/r)
            deflect[2]=0
            p1+=(deflect/2)*factor
            p2-=(deflect/5)*factor
            pts[i]=p2
            
    return p1

def _repel2d(index,pts,field_r=6,factor=2):
    ip=pts[index]
    for i in range(len(pts)):
        if i==index:
            continue
        p=pts[i]
        dist=rs.Distance(ip,p)
        if dist<field_r:
            deflect=rs.VectorUnitize(p-ip)
            deflect=rs.VectorScale(deflect,field_r-dist)
            deflect[2]=0
            ip+=(deflect/2)*factor
            p-=(deflect/2)*factor
            pts[i]=p
    pts[index]=ip

def field_push2d(ip,fpts,fwts,f_r=30,dfactor=1,wfactor=2,vfactor=0.5):
        push=Vector3d(0,0,0)
        for i in range(len(fpts)):
            p=fpts[i]
            w=fwts[i]
            dist=rs.Distance(ip,p)
            if dist<f_r:
                amp=vfactor*((w*wfactor)/(dist*dfactor))
                #print('    ',amp)
                ipush=rs.VectorUnitize(p-ip)
                ipush=rs.VectorScale(ipush,amp)
                ipush[2]=0
                push+=ipush
        return push
def field_vector_push(ip,fpts,fvects):
    pass

def points_closest_point(p,pts):
    cp=pts[0]
    cd=rs.Distance(p,cp)
    ci=0
    for i in range(len(pts)):
        tp=pts[i]
        d=rs.Distance(p,tp)
        if d<cd:
            cd=d
            cp=tp
            ci=i
    return cp,cd,ci



if run:
    for i in range(len(opts)):
        #if end_conds[i]:
        #    continue
        op=opts[i]
        last_pt=last_pts[i]
        
        v=wvect
        fp=field_push2d(op,fpts,fwts)
        print(fp)
        v+=fp
        op+=v
        op=repel(op,otrail)
        opts[i]=op
        otrail.append(op)
        
        
        #else:
        #    end_conds[i]=True
        
        if rs.Distance(op,last_pt)>1 and step%interval==0:
            pass
            #TODO: add trail curves
        
    
    #O_VECTS=ovects
    O_PTS=opts
    O_TRAIL=otrail
    #O_SEGMENTS=osegments
    
else:
    end_conds=[False]*len(ipts)
    
    fpts=field_pts
    fwts=field_weights
    wvect=rs.VectorScale(wind_vect,wind_amp)
    
    opts=ipts
    ovects=[]
    
    last_pts=[]
    last_vects=[]
    
    for ipt in ipts:
        #opts.append(ipt)
        last_pts.append(ipt)

    step=0
    osegments=[]
    otrail=[]
# ---------- end pyflow2 ----------

timer_4 = Timer(TimerInterval=50, Target=pyflow2)  # disabled
panel_2 = Panel(number)
point_3 = Point(pyflow2.O_TRAIL)

# ==== cluster Gen_grid
S = ClusterInput()
U = ClusterInput()
V = ClusterInput()
mesh_uv = MeshSurface(Surface=S, UCount=U, VCount=V, Overhang=True, Equalize=False)
demesh = DeconstructMesh(Mesh=mesh_uv)  # -> Vertices, Faces, Colours, Normals
V_2 = ClusterOutput(demesh.Vertices)

# ==== cluster Pts_closest_mesh
pt_grid = ClusterInput()
pt_grid_2 = Point(pt_grid)
mesh = ClusterInput()
plane = ClusterInput()
mesh_plane = MeshPlane(Mesh=mesh, Plane=plane)
python_script = PythonScript(pts=pt_grid_2, crvs=mesh_plane)  # -> out, O_DIST, O_PTS; inputs pts: list of Point3d, crvs: list of Curve
# ---------- python_script: Python ----------
import rhinoscriptsyntax as rs
odist=[]
opts=[]
for p in pts:
    cp=None
    d=100000000
    for c in crvs:
        ct=rs.CurveClosestPoint(c,p)
        xp=rs.EvaluateCurve(c,ct)
        xd=rs.Distance(p,xp)
        if xd<d:
            d=xd
            cp=xp
    odist.append(d)
    opts.append(cp)
    
O_DIST=odist
O_PTS=opts
# ---------- end python_script ----------
point = Point(python_script.O_PTS)
gradient = Gradient(
    LowerLimit=expr("-x", "50"),
    UpperLimit="50",
    Parameter=python_script.O_DIST,
    stops=[0: RGB(234, 38, 0), 0.25: RGB(234, 126, 0), 0.5: RGB(254, 244, 84), 0.75: RGB(173, 203, 249), 1: RGB(75, 107, 169)])
bnd = Bounds(Numbers=python_script.O_DIST)
custom_preview = CustomPreview(Geometry=pt_grid_2, Shader=gradient)
dedomain = DeconstructDomain(Domain=bnd)  # -> Start, End
pt_grid_3 = ClusterOutput(pt_grid_2)
E = ClusterOutput(dedomain.End)
S = ClusterOutput(dedomain.Start)
o_dist = ClusterOutput(python_script.O_DIST)

# ==== cluster Elevate_pts
F = ClusterInput()
Z = UnitZ(Factor=F)
G = ClusterInput()
move = Move(Geometry=G, Motion=Z)  # -> Geometry, Transform
G_2 = ClusterOutput(move.Geometry)

# ==== cluster Cluster
D = ClusterInput()
Y = UnitY(Factor=1)
rad = Radians(Degrees=D)
rotate = Rotate(Geometry=Y, Angle=rad, Plane=PlaneXY(0, 0, 0))  # -> Geometry, Transform
G = ClusterOutput(rotate.Geometry)

# ==== cluster PointsOutsideBrep
B = ClusterInput()
P = ClusterInput()
brepsinc = PointInBreps(Brep=B, Point=P, Strict=False)  # -> Inside, Index
dispatch = Dispatch(List=P, DispatchPattern=brepsinc.Inside)  # -> ListA, ListB
B_2 = ClusterOutput(dispatch.ListB)

# ==== cluster DisplayPath
G = ClusterInput()
V = ClusterInput()
A = ClusterInput()
amp = Amplitude(Vector=expr("-x", V), Amplitude=expr("x/2", A))
move = Move(Geometry=G, Motion=amp)  # -> Geometry, Transform
move_2 = Move(Geometry=move.Geometry, Motion=V)  # -> Geometry, Transform
G_2 = ClusterOutput(move.Geometry)
G_3 = ClusterOutput(move_2.Geometry)
ln = Line(StartPoint=move.Geometry, EndPoint=move_2.Geometry)
L = ClusterOutput(ln)

# ==== cluster Cluster_2
run = ClusterInput()
timer = Timer(TimerInterval=100)
python = GhPythonScript(run=run)  # -> out, O_T1, O_AMP1, O_T2, O_AMP2; inputs run: Boolean
# ---------- python: Python ----------
__author__ = "seah"

import rhinoscriptsyntax as rs
step=0.1
amp=0.5

def iter(num):
    num+=step
    if num>1:
        num=0
    return num
    
def get_amp(t1,t2):
    if t2-t1>0.5:
        return 0.5
    else: 
        return (t2-t1)


if run :
    t1=iter(t1)
    amp1=get_amp(t1,1)
    t2=iter(t2)
    amp2=get_amp(t2,1)
    
    O_T1=t1
    O_AMP1=amp1
    O_T2=t2
    O_AMP2=amp2
    
else:
    t1=0.0
    t2=0.5
# ---------- end python ----------
V = ClusterInput()
C = ClusterInput()
amp = Amplitude(Vector=V, Amplitude=python.O_AMP1)
eval = EvaluateCurve(Curve=C, Parameter=python.O_T1)  # -> Point, Tangent, Angle
P = ClusterOutput(eval.Point)
